# Grasshopper definition Image Based Mapping.gh (Grasshopper 1.0.7)

number_slider = Slider(200, range=0..200)
number_slider_2 = Slider(1000, range=0..1000)
series = Series(Start=0, Step=1, Count=number_slider)
series_2 = Series(Start=0, Step=1, Count=Slider(200, range=0..200))
crossref = CrossReference(ListA=series, ListB=series_2, CrossMode=1)  # -> ListA, ListB
pt = ConstructPoint(XCoordinate=crossref.ListA, YCoordinate=crossref.ListB, ZCoordinate=0)
Y = UnitY(Factor=1)
Z = UnitZ(Factor=1)
image = ImageSampler(pt, Filter="Colour", Interpolate=False, Umax=1, Umin=0, Vmax=1, Vmin=0, Wrap=1)
panel = Panel(image)
line = LineSDL(Start=pt, Direction=Z, Length=panel)
partition = PartitionList(List=line, Size=number_slider)
end = EndPoints(Curve=partition)  # -> Start, End
pline = PolyLine(Vertices=end.Start, Closed=False)
pline_2 = PolyLine(Vertices=end.End, Closed=False)
weave = Weave(Pattern=[0, 1], Stream0=pline, Stream1=pline_2, NullGaps=False)
loft = Loft(Curves=weave, Options={Adjust=False, Closed=False, LoftEnds=0, LoftSimp=0, LoftType=0, Rebuild=10, Refit=0.01})
